vi "webvipolyfill.gviweb"   [LabVIEW NXG 2.1.0]
inputs:
  "action": string, required
  "input": string
  "error in": error
outputs:
  "output": string
  "error out": error
uses:
  NI::HTTP::POST Buffer.gvi
  NI::G Core::Error::Is Error.gvi
  NI::G Core::Error::Build Error Cluster.gvi
diagram:
  case ($"error in") {
    frame Error, Default {
      w1 = $"error in"
    }
    frame No Error {
      Concatenate Strings("webvipolyfill:", $action) -> w2
      call "POST Buffer.gvi"(timeout=-1, client handle=0, url=w2, buffer=$input, error in=$"error in", output file=path constant) -> (status code=w3, body=w4, error out=w5)
      $output <- w4
      case (w3) {
        frame Default {
          w8 = 0  # no error
          w6 = w8
          w7 = ""
        }
        frame 44300 {
          w9 = "An exception occurred invoking the external JavaScript function ("
          Concatenate Strings(w9, $action, ") with the following input (", $input, ").") -> w7
          w6 = w3
        }
        frame 44302 {
          Concatenate Strings("The JavaScript function (", $action, ") could not be found") -> w7
          w6 = w3
        }
        frame 44304 {
          Concatenate Strings("Invalid return type from JavaScript function (", $action, ") invoked with input (", $input, "). Must return a JavaScript String.") -> w7
          w6 = w3
        }
      }
      w10 = "Error attempting to invoke the webvipolyfill library. Make sure webvipolyfill.js is added to your Web Application component and as a script tag in the HTML of your Top-Level gviweb."
      w11 = 10000  # error
      w12 = 0  # no error
      call "Is Error.gvi"(error in=w5) -> (error?=w13)
      Select(s=w13, t=w11, f=w12) -> w14
      call "Build Error Cluster.gvi"(error in=no error, code=w14, description=w10, include call chain=TRUE, make warning=FALSE) -> (error out=w15)
      To Long Integer(number=w6) -> w16
      call "Build Error Cluster.gvi"(error in=w15, code=w16, description=w7, include call chain=TRUE, make warning=FALSE) -> (error out=w1)
    }
  }
  $"error out" <- w1
