vi "Write to System Log [webvipolyfill].gviweb"   [LabVIEW NXG 2.1.0]
# Writes a message to the output pane accessible from Tool Launcher > All > Output in LabVIEW NXG or the browser development tools console usually accessible with F12 in the browser.
inputs:
  "message": string, required  # message is the text to write to the system log.
  "severity": i32 = "Error"(0)
  "error in": error
outputs:
  "error out": error
types:
  T1 = cluster{"webvipolyfill_version": i32, "severity": i32, "message": string}
uses:
  webvipolyfill::webvipolyfill_version.gviweb
  webvipolyfill::webvipolyfill.gviweb
diagram:
  call "webvipolyfill_version.gviweb"() -> (webvipolyfill_version=w1)
  Property Node(instance in=T1 {all zero or empty}, "webvipolyfill_version"=w1, "severity"=$severity, "message"=$message) -> (instance out=w2)
  Flatten To JSON(anything=w2, enable LabVIEW extensions=TRUE, error in (no error)=$"error in") -> (JSON string=w3, error out=w4)
  call "webvipolyfill.gviweb"(action="webvipolyfill_writetosystemlog", input=w3, error in=w4) -> (error out=w5)
  $"error out" <- w5
